# Grasshopper definition Test1.ghx (Grasshopper 1.0.8)
# Copyright: Copyright 2024 Corgan Associates, Inc

# Corgan Practice Technology Grasshopper Template 0.1
number_slider = Slider(10, range=0..50)

# ----
# Mapped 3D text object
planar = BoundarySurfaces()
pt = ConstructPoint(XCoordinate=0, YCoordinate=0, ZCoordinate=0)
extr = Extrude(Base=planar, Direction=pt)
rotate = Rotate(Geometry=extr, Center=Point(0, 0, 0), From=Vector(1, 0, 0), To=Vector(0, 1, 0))  # -> Geometry, Transform
bbox = BoundingBox(Content=rotate.Geometry, Plane=PlaneXY(0, 0, 0), UnionBox=True)  # -> Box, Box_2
debox = DeconstructBox(Box=bbox.Box)  # -> Plane, X, Y, Z
multiplication = Multiplication(B=0.5)
mirror = Mirror(Geometry=rotate.Geometry, Plane=PlaneYZ(0, 0, 0))  # -> Geometry, Transform
dedomain = DeconstructDomain(Domain=debox.Y)  # -> Start, End
dedomain_2 = DeconstructDomain(Domain=debox.X)  # -> Start, End
multiplication_2 = Multiplication(A=dedomain_2.Start, B=-1)
addition = Addition(A=multiplication_2, B=dedomain_2.End)
addition_2 = Addition(A=multiplication, B=dedomain.Start)
addition_3 = Addition(A=multiplication, B=dedomain.End)
dom = ConstructDomain(DomainStart=0, DomainEnd=addition)
dom_2 = ConstructDomain(DomainStart=addition_2, DomainEnd=addition_3)
dom_3 = ConstructDomain(DomainStart=0, DomainEnd=1)
srfmorph = SurfaceMorph(Geometry=mirror.Geometry, Reference=bbox.Box, UDomain=dom, VDomain=dom_2, WDomain=dom_3)

populate_3d = Populate3D(Region={Plane=PlaneXY(0, 0, 0), X=Domain(0, 10), Y=Domain(0, 10), Z=Domain(0, 2)}, Count=number_slider, Seed=1)
text = Text()
panel = Panel(text)
panel_2 = Panel(populate_3d)
sphere = Sphere(Base=panel_2, Radius=1)
sphere_2 = Sphere(Base=panel_2, Radius=1)
pline = PolyLine(Closed=False)  # -> flatten(Polyline)
relay = Relay()

# ---- group: Loft between Polylines
loft_mesh = CSharpScript(Polylines=pline, Weld=relay, TooltipTextOverride="Create a lofted mesh through a set of section polylines")  # -> Mesh; inputs Polylines: tree of Polyline, Weld: Double
# ---------- loft_mesh: C# usings ----------
using System.IO;
using System.Linq;
using System.Data;
using System.Drawing;
using System.Reflection;
using System.Windows.Forms;
using System.Xml;
using System.Xml.Linq;
using System.Runtime.InteropServices;

using Rhino.DocObjects;
using Rhino.Collections;
using GH_IO;
using GH_IO.Serialization;
# ---------- loft_mesh: C# ----------
    // create mesh
    List<int> indices = new List<int>();
    DataTree<Mesh> meshes = new DataTree<Mesh>();
    DataTree<System.Object> finalmeshes = new DataTree<System.Object>();

    // first two vertices
    for ( int k = 0; k < Polylines.BranchCount; k++ ) {
      if (Polylines.Branch(k).Count == 0){
        meshes.Add(new Mesh(), new GH_Path(Polylines.Path(k)));
      }
      else{
        for ( int j = 1; j < Polylines.Branch(k).Count; j++ ) {
          Polyline p = Polylines.Branch(k)[j - 1];
          Polyline q = Polylines.Branch(k)[j];

          Mesh m = new Mesh();

          indices.Add(m.Vertices.Add(p[0]));
          indices.Add(m.Vertices.Add(q[0]));

          // remaining vertices and faces
          for ( int i=1, imax = p.Count; i < imax; i++ ) {
            indices.Add(m.Vertices.Add(p[i]));
            indices.Add(m.Vertices.Add(q[i]));
            int len = 2 + 2 * i;
            m.Faces.AddFace(len - 4, len - 3, len - 1, len - 2);
          }

          meshes.Add(m, new GH_Path(Polylines.Path(k)));
        }
      }

      //Clean Mesh
      meshes.Branch(k)[0].Append(meshes.Branch(k).GetRange(1, meshes.Branch(k).Count - 1));
      meshes.Branch(k)[0].Vertices.CombineIdentical(true, true);
      meshes.Branch(k)[0].Unweld(Weld, true);
      meshes.Branch(k)[0].RebuildNormals();

      //Add null if mesh in branch is empty
      if (meshes.Branch(k)[0].Faces.Count == 0){
        finalmeshes.Add(null, new GH_Path(Polylines.Path(k)));
      }else{
        finalmeshes.Add(meshes.Branch(k)[0], new GH_Path(Polylines.Path(k)));
      }
    }

    Mesh = finalmeshes;
# ---------- end loft_mesh ----------

# ----
mesh = Mesh(loft_mesh)
panel_3 = Panel(mesh)
